# Dynamo custom node DynLineToRvtLine.dyf (Dynamo 2.12.0.5650)
# category: JNO

line = Input(line: Autodesk.DesignScript.Geometry.Line)
startPoint = Curve.StartPoint(curve=line)
endPoint = Curve.EndPoint(curve=line)
python_script = Python(IN[0]=startPoint, IN[1]=endPoint)  # IronPython2
# ---------- python_script.python (31 lines) ----------
import clr

clr.AddReference('RevitAPI')
from Autodesk.Revit.DB import *
from Autodesk.Revit.DB.Structure import *

clr.AddReference('RevitAPIUI')
from Autodesk.Revit.UI import *

clr.AddReference('System')
from System.Collections.Generic import List

clr.AddReference('RevitNodes')
import Revit
clr.ImportExtensions(Revit.GeometryConversion)
clr.ImportExtensions(Revit.Elements)

clr.AddReference('RevitServices')
import RevitServices
from RevitServices.Persistence import DocumentManager
from RevitServices.Transactions import TransactionManager

doc = DocumentManager.Instance.CurrentDBDocument
uidoc=DocumentManager.Instance.CurrentUIApplication.ActiveUIDocument

#Preparing input from dynamo to revit
startPoint = IN[0]
endPoint = IN[1]
line = Line.CreateUnbound(startPoint.ToXyz(), endPoint.ToXyz())

OUT = line
# ----------------------------------------
OUT = Output(python_script)
