# Dynamo custom node DynPlaneToRvtPlane.dyf (Dynamo 2.12.0.5650)
# category: JNO

dynPlane = Input(dynPlane: Autodesk.DesignScript.Geometry.Plane)
origin = Plane.Origin(plane=dynPlane)
normal = Plane.Normal(plane=dynPlane)
python_script = Python(IN[0]=origin, IN[1]=normal)  # IronPython2
# ---------- python_script.python (28 lines) ----------
import clr

clr.AddReference('RevitAPI')
from Autodesk.Revit.DB import *
from Autodesk.Revit.DB.Structure import *

clr.AddReference('RevitAPIUI')
from Autodesk.Revit.UI import *

clr.AddReference('System')
from System.Collections.Generic import List

clr.AddReference('RevitNodes')
import Revit
clr.ImportExtensions(Revit.GeometryConversion)
clr.ImportExtensions(Revit.Elements)

clr.AddReference('RevitServices')
import RevitServices
from RevitServices.Persistence import DocumentManager
from RevitServices.Transactions import TransactionManager

origin = IN[0]
normal = IN[1]

revitPlane = Plane.CreateByNormalAndOrigin(normal.ToXyz(), origin.ToXyz())

OUT = revitPlane
# ----------------------------------------
OUT = Output(python_script)
