# Dynamo custom node DynPointToXyz.dyf (Dynamo 2.12.0.5650)
# category: JNO

dynPoint = Input(dynPoint: Autodesk.DesignScript.Geometry.Point)
python_script = Python(IN[0]=dynPoint)  # IronPython2
# ---------- python_script.python (29 lines) ----------
import clr

clr.AddReference('RevitAPI')
from Autodesk.Revit.DB import *
from Autodesk.Revit.DB.Structure import *

clr.AddReference('RevitAPIUI')
from Autodesk.Revit.UI import *

clr.AddReference('System')
from System.Collections.Generic import List

clr.AddReference('RevitNodes')
import Revit
clr.ImportExtensions(Revit.GeometryConversion)
clr.ImportExtensions(Revit.Elements)

clr.AddReference('RevitServices')
import RevitServices
from RevitServices.Persistence import DocumentManager
from RevitServices.Transactions import TransactionManager

doc = DocumentManager.Instance.CurrentDBDocument
uidoc=DocumentManager.Instance.CurrentUIApplication.ActiveUIDocument

#Preparing input from dynamo to revit
pt = IN[0]

OUT = pt.ToXyz()
# ----------------------------------------
OUT = Output(python_script)
