# Dynamo custom node ExtendCurveStartEnd.dyf (Dynamo 2.12.0.5650)
# category: JNO

curve = Input(curve: var[]..[])
distance = Input(distance: var[]..[])
extendEnd = Curve.ExtendEnd(curve=curve, distance=distance)
extendStart = Curve.ExtendStart(curve=extendEnd, distance=distance)
Curve = Output(extendStart)
