# Dynamo custom node FamilyInstanceAtReferencePlane.dyf (Dynamo 2.12.0.5650)
# category: JNO

symbol = Input(symbol: var[]..[])
refPlane = Input(refPlane: var[]..[])
location = Input(location: var[]..[])
referenceDirection = Input(referenceDirection: var[]..[])
code_block = CodeBlock(symbol=symbol, refPlane=refPlane, location=location, referenceDirection=referenceDirection) { symbol; refPlane; location; referenceDirection; }
python_script = Python(IN[0]=code_block.symbol, IN[1]=code_block.refPlane, IN[2]=code_block.location, IN[3]=code_block.referenceDirection)  # IronPython2
# ---------- python_script.python (36 lines) ----------
import clr
clr.AddReference('RevitNodes')
import Revit
clr.ImportExtensions(Revit.GeometryConversion)
from Revit.Elements import *
clr.AddReference('System')
from System.Collections.Generic import *
clr.AddReference('RevitAPI')
from Autodesk.Revit.DB import *
clr.AddReference('RevitServices')
import RevitServices
from RevitServices.Persistence import DocumentManager
from RevitServices.Transactions import TransactionManager

doc = DocumentManager.Instance.CurrentDBDocument
uiapp = DocumentManager.Instance.CurrentUIApplication
app = uiapp.Application
#The inputs to this node will be stored as a list in the IN variables.
dataEnteringNode = IN
symbol = UnwrapElement(IN[0])
refPlane = UnwrapElement(IN[1])
location = UnwrapElement(IN[2])
referenceDirection = UnwrapElement(IN[3])
out = []

symbol.Activate()
reference = Reference(refPlane)

TransactionManager.Instance.EnsureInTransaction(doc)

new = doc.Create.NewFamilyInstance(reference,location.ToXyz(),referenceDirection.ToXyz(),symbol)

TransactionManager.Instance.TransactionTaskDone()

#Assign your output to the OUT variable.
OUT = new
# ----------------------------------------
instance = Output(python_script)
