# Dynamo custom node GetGroundFloorLevel.dyf (Dynamo 2.12.0.5650)
# category: JNO
# Returns the level which has elevation 0

categories = Categories("OST_Levels")
all_elements_of_category = ElementsOfCategory(Category=categories)
elevation = Level.Elevation(level=all_elements_of_category)
code_block = CodeBlock(elevation=elevation) { elevation == 0; }
filterByBoolMask = List.FilterByBoolMask(list=all_elements_of_category, mask=code_block)
level = Output(filterByBoolMask.in)  # "level : Level"
