# Dynamo custom node RectangleFromPoint.dyf "Rectangle_From_Point" (Dynamo 2.12.0.5650)
# category: JNO
# Rectangle with origin at given point. Length = x length. Width = y.

origin = Input(origin: Autodesk.DesignScript.Geometry.Point)
XAxis = Vector.XAxis()
rect_width_x = Input(rect_width_x: var[]..[])
rect_length_y = Input(rect_length_y: var[]..[])
code_block = CodeBlock(building_width_x=rect_width_x, building_length_y=rect_length_y) { building_width_x; building_length_y; }
translate = Geometry.Translate(geometry=origin, direction=XAxis, distance=code_block.building_width_x)
YAxis = Vector.YAxis()
translate_2 = Geometry.Translate(geometry=translate, direction=YAxis, distance=code_block.building_length_y)
translate_3 = Geometry.Translate(geometry=origin, direction=YAxis, distance=code_block.building_length_y)
byCornerPoints = Rectangle.ByCornerPoints(p1=origin, p2=translate, p3=translate_2, p4=translate_3)
Rectangle = Output(byCornerPoints)
code_block_2 = CodeBlock(p1=origin, p2=translate, p3=translate_2, p4=translate_3) { [p1,p2,p3,p4]; }
