# Dynamo custom node Run.dyf (Dynamo 2.12.0.5650)
# category: JNO
# Passes the stream if run==true, else returns null

run = Input(run: bool)
stream = Input(stream: var[]..[])
python_script = Python(IN[0]=run, IN[1]=stream)  # IronPython2
# ---------- python_script.python (7 lines) ----------
run = IN[0]
input = IN[1]

if run:
	OUT = input
else:
	OUT = []
# ----------------------------------------
stream_2 = Output(python_script)  # "stream"
