# Dynamo custom node TestCreateRefPlane.dyf (Dynamo 2.12.0.5650)
# category: JNO

stpt = Input(stpt: Autodesk.DesignScript.Geometry.Point)
endpt = Input(endpt: Autodesk.DesignScript.Geometry.Point)
cutVec = Input(cutVec: Autodesk.DesignScript.Geometry.Vector)
python_script = Python(IN[0]=stpt, IN[1]=endpt, IN[2]=cutVec)  # IronPython2
# ---------- python_script.python (54 lines) ----------
import clr

clr.AddReference('RevitAPI')
from Autodesk.Revit.DB import *
from Autodesk.Revit.DB.Structure import *

clr.AddReference('RevitAPIUI')
from Autodesk.Revit.UI import *

clr.AddReference('System')
from System.Collections.Generic import List

clr.AddReference('RevitNodes')
import Revit
clr.ImportExtensions(Revit.GeometryConversion)
clr.ImportExtensions(Revit.Elements)

clr.AddReference('RevitServices')
import RevitServices
from RevitServices.Persistence import DocumentManager
from RevitServices.Transactions import TransactionManager

doc = DocumentManager.Instance.CurrentDBDocument
uidoc=DocumentManager.Instance.CurrentUIApplication.ActiveUIDocument

#Preparing input from dynamo to revit
element = UnwrapElement(IN[0])

#Do some action in a Transaction
TransactionManager.Instance.EnsureInTransaction(doc)


bubbleEnd = UnwrapElement(IN[0]).ToXyz()
freeEnd = UnwrapElement(IN[1]).ToXyz()
cutVec = UnwrapElement(IN[2]).ToXyz()
#forcenormal = IN[3]

testplane = Plane.CreateByThreePoints(bubbleEnd, freeEnd, cutVec)
testnormal = testplane.Normal

refPlane = doc.Create.NewReferencePlane(bubbleEnd, freeEnd, cutVec, doc.ActiveView);

normal = refPlane.Normal

#equal = normal.IsAlmostEqualTo(forcenormal.ToXyz())

#if not equal:
#	refPlane = doc.Create.NewReferencePlane(bubbleEnd, freeEnd, cutVec * -1, doc.ActiveView);

#equal = normal.IsAlmostEqualTo(forcenormal.ToXyz())

TransactionManager.Instance.TransactionTaskDone()

OUT = refPlane
# ----------------------------------------
refplane = Output(python_script)
