# Dynamo custom node VisualizePoints.dyf (Dynamo 2.12.0.5650)
# category: JNO

point = Input(point: Autodesk.DesignScript.Geometry.Point)
radius = Input(radius: int = 1200)
byCenterPointRadius = Sphere.ByCenterPointRadius(centerPoint=point, radius=radius)
Sphere = Output(byCenterPointRadius)
