# Dynamo custom node VisualizeVector.dyf (Dynamo 2.12.0.5650)
# category: JNO

startpoint = Input(startpoint: Autodesk.DesignScript.Geometry.Point)
vector = Input(vector: Autodesk.DesignScript.Geometry.Vector)
size = Input(size: int)
code_block = CodeBlock(startpoint=startpoint, vector=vector, size=size) { startpoint; vector; size; }
translate = Geometry.Translate(geometry=code_block.startpoint, direction=code_block.vector, distance=code_block.size)
byStartPointEndPoint = Line.ByStartPointEndPoint(startPoint=code_block.startpoint, endPoint=translate)
Line = Output(byStartPointEndPoint)
