# Dynamo custom node XY_Plane_at_Z_level.dyf (Dynamo 2.12.0.5650)
# category: JNO
# Creates an XY plane at the given Z height

Z_height = Input(Z_height: int)
byCoordinates = Point.ByCoordinates(z=Z_height)
ZAxis = Vector.ZAxis()
byOriginNormal = Plane.ByOriginNormal(origin=byCoordinates, normal=ZAxis)
Plane = Output(byOriginNormal)
